% Simulink design studies multiple_params.mldatx for model model

study "DesignStudy":  simulations
  combinatorial set ( points):
    "Variable_1": Variable(), values  ( points)
    "Variable_2": Variable(), values  ( points)
    "Block Parameter_1": BlockParameter(), values  ( points)