% Simulink design studies more_params_sweep.mldatx for model model

study "DesignStudy": 141 simulations
  combinatorial set (141 points):
    "Ft": Variable(Name=Ft), values 70:5:300 (47 points)
    "Variable_1": Variable(Name=beta), values [-0.2,0.05,0.2] (3 points)